# Grasshopper definition grasshopper-parametric-box.gh (Grasshopper 1.0.8)

width = Slider(6, range=0.1..20)
depth = Slider(2, range=0.1..20)
height = Slider(3, range=0.1..20)
dom = ConstructDomain(DomainStart=0, DomainEnd=width)
dom_2 = ConstructDomain(DomainStart=0, DomainEnd=depth)
dom_3 = ConstructDomain(DomainStart=0, DomainEnd=height)
editable_box = DomainBox(Base=PlaneXY(0, 0, 0), X=dom, Y=dom_2, Z=dom_3)
